# Dynamo graph BeyondTheSpeckleverse_Walls_fromStreamLink.dyn (Dynamo 2.13.1.3887)
# packages: SpeckleDynamo2 2.0.0

# group: ABOUT
# Script description
# note: Last Update: June 08, 2024
# by Agustina Aboy
# note: This Script takes geoemetries from inputed Speckle stream, filters elements tagged as walls, gets geometry and Creates Revit Walls to match those properties.

# group: Input
stream_link = StringInput("https://app.speckle.systems/projects/0cbda26868/models/92fd87c60c")  # graph input
wall_types = WallTypes("Wall-Ext_102Bwk-50Air-45Ins-100DBlk-12P")  # graph input

# group: Get Meshes from stream
autoReceive = Speckle.ConnectorDynamo.Functions.Auto.AutoReceive(stream=stream_link)
code_block = CodeBlock { "data"; }
valueAtKey = DesignScript.Builtin.Dictionary.ValueAtKey(dictionary=autoReceive, key=code_block)
code_block_2 = CodeBlock { "Custom Elements from Python"; }
valueAtKey_2 = DesignScript.Builtin.Dictionary.ValueAtKey(dictionary=valueAtKey, key=code_block_2)
toSpeckle = Speckle.ConnectorDynamo.Functions.Developer.Conversion.ToSpeckle(data=valueAtKey_2@L1)
serialize = Speckle.ConnectorDynamo.Functions.Developer.Serialization.Serialize(base=toSpeckle)
searched_tag = StringInput("\"type\":\"wall\"")
contains = String.Contains(string=serialize, searchFor=searched_tag)
filterByBoolMask = List.FilterByBoolMask(list=valueAtKey_2, mask=contains)
vertexPositions = Mesh.VertexPositions(mesh=filterByBoolMask.in)
faceIndices = Mesh.FaceIndices(mesh=filterByBoolMask.in)
byPointsFaceIndices = Mesh.ByPointsFaceIndices(vertexPositions=vertexPositions, indices=faceIndices)

# group: Mesh to geometry
vertexPositions_2 = Mesh.VertexPositions(mesh=byPointsFaceIndices)
code_block_3 = CodeBlock { 0; 4; 1; }

# group: Get Wall Lines from Meshes
slice = List.Slice(list=vertexPositions_2@L2, start=code_block_3.out0, end=code_block_3.out1, step=code_block_3.out2)
XY = Plane.XY()
ZAxis = Vector.ZAxis()
project = Point.Project(point=slice, baseGeometry=XY, projectionDirection=ZAxis)
flatten = List.Flatten(list=project@L3)
pruneDuplicates = Point.PruneDuplicates(points=flatten)
transpose = List.Transpose(lists=pruneDuplicates)
code_block_4 = CodeBlock { 0; 1; }

# group: Set Wall Curve
getItemAtIndex = List.GetItemAtIndex(list=transpose@L1, index=code_block_4.out0)
getItemAtIndex_2 = List.GetItemAtIndex(list=transpose, index=code_block_4.out1)
byStartPointEndPoint = Line.ByStartPointEndPoint(startPoint=getItemAtIndex, endPoint=getItemAtIndex_2)
width = WallType.Width(wallType=wall_types)
offset = CodeBlock(w=width) { -w/2; }
offset_2 = Curve.Offset(curve=byStartPointEndPoint, distance=offset)

# group: Get Level at Elevation 0
code_block_5 = CodeBlock { "Levels"; }
byName = Category.ByName(name=code_block_5)
all_elements_of_category = ElementsOfCategory(Category=byName)
code_block_6 = CodeBlock { "Elevation"; }
getParameterValueByName = Element.GetParameterValueByName(element=all_elements_of_category, parameterName=code_block_6)
code_block_7 = CodeBlock(elev=getParameterValueByName) { elev==0; }
filterByBoolMask_2 = List.FilterByBoolMask(list=all_elements_of_category, mask=code_block_7)

firstItem = List.FirstItem(list=filterByBoolMask_2.in)
watch = Watch(firstItem)

# group: Create Levels
Z = Point.Z(point=vertexPositions_2)
flatten_2 = List.Flatten(list=Z)
uniqueItems = List.UniqueItems(list=flatten_2)
maximumItem = List.MaximumItem(list=uniqueItems)
minimumItem = List.MinimumItem(list=uniqueItems)
code_block_8 = CodeBlock(max=maximumItem, min=minimumItem) { Elev=max - min; }
code_block_9 = CodeBlock { "T.O.Wall"; }
byElevationAndName = Level.ByElevationAndName(elevation=code_block_8, name=code_block_9)

watch_2 = Watch(byElevationAndName)
watch_3 = Watch(wall_types)

# group: To Revit
byCurveAndLevels = Wall.ByCurveAndLevels(curve=offset_2, startLevel=watch, endLevel=watch_2, wallType=watch_3)

watch_4 = Watch(byCurveAndLevels)
